# Grasshopper definition Casestudy.gh (Grasshopper 1.0.7)
# plug-ins: LunchBox, LadybugGrasshopper

# ----
# Datapath
falsestart = LBFalseStartToggle(False)
filepath = FilePath("C:\Users\Name\OneDrive - Delft University of Technology\Building Technology-Thesis\CaseStudy\CaseStudy2\df_casestudy2.csv")

# ----
# Design2 input
start_area_id_number = Panel("200")
design_name = Panel("Design2")
room_types = Panel("""BEDROOM
BEDROOM
LIVING_ROOM
BATHROOM
CORRIDOR
KITCHEN
BATHROOM
BEDROOM
OUTDOOR_SPACE""")
window_sill_m = Panel("0.6")
elevation_m = Panel("8.7")
room_height_m = Panel("2.6")
window_height_m = Panel("2")
outside_door_height_m = Panel("2.4")

# ----
# Design3 input
design_name_2 = Panel("Design3")
start_area_id_number_2 = Panel("300")
room_types_2 = Panel("""BEDROOM
BEDROOM
CORRIDOR
BATHROOM
KITCHEN
LIVING_ROOM
BEDROOM
OUTDOOR_SPACE""")
window_sill_m_2 = Panel("0.2")
elevation_m_2 = Panel("8.7")
room_height_m_2 = Panel("2.6")
window_height_m_2 = Panel("1.5")
outside_door_height_m_2 = Panel("2.4")

# ----
# Design1 input
start_area_id_number_3 = Panel("100")
design_name_3 = Panel("Design1")
room_types_3 = Panel("""BEDROOM
BEDROOM
BEDROOM
CORRIDOR
BATHROOM
KITCHEN
BATHROOM
LIVING_ROOM
OUTDOOR_SPACE""")
window_sill_m_3 = Panel("0.4")
elevation_m_3 = Panel("8.7")
room_height_m_3 = Panel("2.6")
window_height_m_3 = Panel("1.6")
outside_door_height_m_3 = Panel("2.4")

floor_outdoorspaces_polygon = Geometry([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])
outsidedoor_polygons = Geometry(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)
window_polygons = Geometry([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])
spaces_polygons = Geometry([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])
door_polygons = Geometry([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])
floor_polygon = Geometry(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)

floor_outdoorspaces_polygon_2 = Geometry([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])
outsidedoor_polygons_2 = Geometry(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)
window_polygons_2 = Geometry([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])
spaces_polygons_2 = Geometry([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])
door_polygons_2 = Geometry([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])
floor_polygon_2 = Geometry(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)

floor_outdoorspaces_polygon_3 = Geometry([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])
outsidedoor_polygons_3 = Geometry(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)
window_polygons_3 = Geometry([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])
spaces_polygons_3 = Geometry([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])
door_polygons_3 = Geometry([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])
floor_polygon_3 = Geometry(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)

panel = Panel(filepath)

# ----
# Data rooms
panel_2 = Panel("df_casestudy1")
excelread = ExcelReader(ReadExcelData=falsestart, WorkbookPath=filepath, WorksheetName=panel_2)  # -> Exceptions, ExcelData
data_casestudy1 = Data(Tree({0}: ["apartment_id", "6b8d4461eb7fe7ba49a4f1278ca47c6a", "6b8d4461eb7fe7ba49a4f1278ca47c6a", "6b8d4461eb7fe7ba49a4f1278ca47c6a", "6b8d4461eb7fe7ba49a4f1278ca47c6a", "6b8d4461eb7fe7ba49a4f1278ca47c6a", "6b8d4461eb7fe7ba49a4f1278ca47c6a", "6b8d4461eb7fe7ba49a4f1278ca47c6a", "6b8d4461eb7fe7ba49a4f1278ca47c6a", "6b8d4461eb7fe7ba49a4f1278ca47c6a"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], {1}: ["site_id", "11726", "11726", "11726", "11726", "11726", "11726", "11726", "11726", "11726"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], {2}: ["building_id", "18299", "18299", "18299", "18299", "18299", "18299", "18299", "18299", "18299"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], {3}: ["plan_id", "42658", "42658", "42658", "42658", "42658", "42658", "42658", "42658", "42658"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], {4}: ["floor_id", "49350", "49350", "49350", "49350", "49350", "49350", "49350", "49350", "49350"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], {5}: ["unit_id", "153329", "153329", "153329", "153329", "153329", "153329", "153329", "153329", "153329"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]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))
bang = ExplodeTree(Data=data_casestudy1)  # -> Branch0, Branch1, Branch2, Branch3, Branch4, Branch5, Branch6, Branch7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
aparmentids = Data(bang.Branch0)
panel_3 = Panel(aparmentids)
elevation = Data(bang.Branch11)
areaids = Data(bang.Branch6)
panel_4 = Panel(bang.Branch6)
panel_5 = Panel(bang.Branch11)
panel_6 = Panel(bang.Branch9)
panel_7 = Panel(bang.Branch10)

# ----
# Design information
createdesigninformation = CreateDesignInformation(
    designname=design_name,
    roomtypes=room_types,
    startareaid=start_area_id_number,
    elevation=elevation_m,
    height=room_height_m,
    roompolygons=spaces_polygons,
    doorpolygons=door_polygons,
    floorpolygon=floor_polygon,
    windowpolygons=window_polygons,
    flooroutdoorspacepolygon=floor_outdoorspaces_polygon,
    windowsill=window_sill_m,
    windowheight=window_height_m,
    outsidedoorpolygons=outsidedoor_polygons,
    outsidedoorheight=outside_door_height_m)  # -> designname_8, areaid_2, entitysubtype_2, geometry_2, elevation_8, height_4, orientation_3, windowarea_2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

# ----
# Design information
createdesigninformation_2 = CreateDesignInformation(
    designname=design_name_2,
    roomtypes=room_types_2,
    startareaid=start_area_id_number_2,
    elevation=elevation_m_2,
    height=room_height_m_2,
    roompolygons=spaces_polygons_2,
    doorpolygons=door_polygons_2,
    floorpolygon=floor_polygon_2,
    windowpolygons=window_polygons_2,
    flooroutdoorspacepolygon=floor_outdoorspaces_polygon_2,
    windowsill=window_sill_m_2,
    windowheight=window_height_m_2,
    outsidedoorpolygons=outsidedoor_polygons_2,
    outsidedoorheight=outside_door_height_m_2)  # -> designname_8, areaid_2, entitysubtype_2, geometry_2, elevation_8, height_4, orientation_3, windowarea_2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

# ----
# Design information
createdesigninformation_3 = CreateDesignInformation(
    designname=design_name_3,
    roomtypes=room_types_3,
    startareaid=start_area_id_number_3,
    elevation=elevation_m_3,
    height=room_height_m_3,
    roompolygons=spaces_polygons_3,
    doorpolygons=door_polygons_3,
    floorpolygon=floor_polygon_3,
    windowpolygons=window_polygons_3,
    flooroutdoorspacepolygon=floor_outdoorspaces_polygon_3,
    windowsill=window_sill_m_3,
    windowheight=window_height_m_3,
    outsidedoorpolygons=outsidedoor_polygons_3,
    outsidedoorheight=outside_door_height_m_3)  # -> designname_8, areaid_2, entitysubtype_2, geometry_2, elevation_8, height_4, orientation_3, windowarea_2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

height = Data(bang.Branch12)
panel_8 = Panel(createdesigninformation.orientation_3)

# ----
# Design5 input
start_area_id_number_4 = Panel("500")
design_name_4 = Panel("Design5")
room_types_4 = Panel("""KITCHEN
LIVING_ROOM
BEDROOM
CORRIDOR
BEDROOM
BATHROOM
BEDROOM
OUTDOOR_SPACE""")
window_sill_m_4 = Panel("0.4")
elevation_m_4 = Panel("8.7")
room_height_m_4 = Panel("2.6")
window_height_m_4 = Panel("1.5")
outside_door_height_m_4 = Panel("2.4")

# ----
# Design6 input
design_name_5 = Panel("Design6")
start_area_id_number_5 = Panel("600")
room_types_5 = Panel("""BEDROOM
LIVING_ROOM
KITCHEN
CORRIDOR
BEDROOM
BATHROOM
BEDROOM
OUTDOOR_SPACE""")
window_sill_m_5 = Panel("0.4")
elevation_m_5 = Panel("8.7")
room_height_m_5 = Panel("2.6")
window_height_m_5 = Panel("1.6")
outside_door_height_m_5 = Panel("2.4")

# ----
# Design4 input
start_area_id_number_6 = Panel("400")
design_name_6 = Panel("Design4")
room_types_6 = Panel("""BEDROOM
LIVING_ROOM
BATHROOM
CORRIDOR
KITCHEN
BEDROOM
BEDROOM
OUTDOOR_SPACE""")
window_sill_m_6 = Panel("0.4")
elevation_m_6 = Panel("8.7")
room_height_m_6 = Panel("2.6")
window_height_m_6 = Panel("1.4")
outside_door_height_m_6 = Panel("2.4")

floor_outdoorspaces_polygon_4 = Geometry([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])
outsidedoor_polygons_4 = Geometry(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)
window_polygons_4 = Geometry([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])
spaces_polygons_4 = Geometry([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])
door_polygons_4 = Geometry([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])
floor_polygon_4 = Geometry(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)

floor_outdoorspaces_polygon_5 = Geometry([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])
outsidedoor_polygons_5 = Geometry(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)
window_polygons_5 = Geometry([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])
spaces_polygons_5 = Geometry([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])
door_polygons_5 = Geometry([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])
floor_polygon_5 = Geometry(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)

floor_outdoorspaces_polygon_6 = Geometry([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])
outsidedoor_polygons_6 = Geometry(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)
window_polygons_6 = Geometry([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])
spaces_polygons_6 = Geometry([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])
door_polygons_6 = Geometry([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])
floor_polygon_6 = Geometry(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)

# ----
# Balcony polygons
panel_9 = Panel("7")
item = ListItem(List=bang.Branch10, Index=panel_9, Wrap=True)
wtk_to_pt = GhPythonScript(wkt_polygon=item)  # -> out, pt_list
# ---------- wtk_to_pt: Python ----------
"""Provides a scripting component.
    Inputs:
        wkt_polygon: Text from dataset with polygon info
    Output:
        x : 
        pt_list: List of points in polygon"""

__author__ = "Name"
__version__ = "2023.07.14"

import rhinoscriptsyntax as rs
import re

text = wkt_polygon

# Extracting the coordinate values using regular expression
matches = re.findall(r'[-\d.]+', text)

# Creating pairs of coordinates
coordinates = [(matches[i], matches[i+1]) for i in range(0, len(matches), 2)]

# Removing brackets and quotes from coordinates
coordinates = [", ".join(coord) for coord in coordinates]

pt_list = coordinates
# ---------- end wtk_to_pt ----------
pt_room = Point(wtk_to_pt.pt_list)
pline = PolyLine(Vertices=pt_room, Closed=False)

# ----
# Room polygons
panel_10 = Panel("""47
48
49
50
51
52
53
54
55
56
57
58
59
60
61""")
item_2 = ListItem(List=bang.Branch10, Index=panel_10, Wrap=True)
wtk_to_pt_2 = GhPythonScript(wkt_polygon=item_2)  # -> out, pt_list; same code as wtk_to_pt
bang_2 = ExplodeTree(Data=wtk_to_pt_2.pt_list)  # -> Branch0, Branch1, Branch2, Branch3, Branch4, Branch5, Branch6, Branch7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
pt_room_2 = Point([bang_2.Branch0, bang_2.Branch1, bang_2.Branch2, bang_2.Branch3, bang_2.Branch4, bang_2.Branch5, bang_2.Branch6, bang_2.Branch7, bang_2.Branch8, bang_2.Branch9, bang_2.Branch10, bang_2.Branch11, bang_2.Branch12, bang_2.Branch13, bang_2.Branch14])
pline_2 = PolyLine(Vertices=pt_room_2, Closed=False)

# ----
# Room polygons
panel_11 = Panel("""1
2
3
4
5
6
8
9
10
11
12""")
item_3 = ListItem(List=bang.Branch10, Index=panel_11, Wrap=True)
wtk_to_pt_3 = GhPythonScript(wkt_polygon=item_3)  # -> out, pt_list; same code as wtk_to_pt
bang_3 = ExplodeTree(Data=wtk_to_pt_3.pt_list)  # -> Branch0, Branch1, Branch2, Branch3, Branch4, Branch5, Branch6, Branch7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
pt_room_3 = Point([bang_3.Branch0, bang_3.Branch1, bang_3.Branch2, bang_3.Branch3, bang_3.Branch4, bang_3.Branch5, bang_3.Branch6, bang_3.Branch7, bang_3.Branch8, bang_3.Branch9, bang_3.Branch10])
pline_3 = PolyLine(Vertices=pt_room_3, Closed=False)

# ----
# Design information
createdesigninformation_4 = CreateDesignInformation(
    designname=design_name_4,
    roomtypes=room_types_4,
    startareaid=start_area_id_number_4,
    elevation=elevation_m_4,
    height=room_height_m_4,
    roompolygons=spaces_polygons_4,
    doorpolygons=door_polygons_4,
    floorpolygon=floor_polygon_4,
    windowpolygons=window_polygons_4,
    flooroutdoorspacepolygon=floor_outdoorspaces_polygon_4,
    windowsill=window_sill_m_4,
    windowheight=window_height_m_4,
    outsidedoorpolygons=outsidedoor_polygons_4,
    outsidedoorheight=outside_door_height_m_4)  # -> designname_8, areaid_2, entitysubtype_2, geometry_2, elevation_8, height_4, orientation_3, windowarea_2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

# ----
# Design information
createdesigninformation_5 = CreateDesignInformation(
    designname=design_name_5,
    roomtypes=room_types_5,
    startareaid=start_area_id_number_5,
    elevation=elevation_m_5,
    height=room_height_m_5,
    roompolygons=spaces_polygons_5,
    doorpolygons=door_polygons_5,
    floorpolygon=floor_polygon_5,
    windowpolygons=window_polygons_5,
    flooroutdoorspacepolygon=floor_outdoorspaces_polygon_5,
    windowsill=window_sill_m_5,
    windowheight=window_height_m_5,
    outsidedoorpolygons=outsidedoor_polygons_5,
    outsidedoorheight=outside_door_height_m_5)  # -> designname_8, areaid_2, entitysubtype_2, geometry_2, elevation_8, height_4, orientation_3, windowarea_2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

# ----
# Design information
createdesigninformation_6 = CreateDesignInformation(
    designname=design_name_6,
    roomtypes=room_types_6,
    startareaid=start_area_id_number_6,
    elevation=elevation_m_6,
    height=room_height_m_6,
    roompolygons=spaces_polygons_6,
    doorpolygons=door_polygons_6,
    floorpolygon=floor_polygon_6,
    windowpolygons=window_polygons_6,
    flooroutdoorspacepolygon=floor_outdoorspaces_polygon_6,
    windowsill=window_sill_m_6,
    windowheight=window_height_m_6,
    outsidedoorpolygons=outsidedoor_polygons_6,
    outsidedoorheight=outside_door_height_m_6)  # -> designname_8, areaid_2, entitysubtype_2, geometry_2, elevation_8, height_4, orientation_3, windowarea_2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

entwine = Entwine(
    Branch00=createdesigninformation_3.designname_8,
    Branch01=createdesigninformation.designname_8,
    Branch02=createdesigninformation_2.designname_8,
    Branch03=createdesigninformation_6.designname_8,
    Branch04=createdesigninformation_4.designname_8,
    Branch05=createdesigninformation_5.designname_8,
    FlattenInputs=True)  # -> flatten(Result)
entwine_2 = Entwine(
    Branch00=createdesigninformation_3.geometry_2,
    Branch01=createdesigninformation.geometry_2,
    Branch02=createdesigninformation_2.geometry_2,
    Branch03=createdesigninformation_6.geometry_2,
    Branch04=createdesigninformation_4.geometry_2,
    Branch05=createdesigninformation_5.geometry_2,
    FlattenInputs=True)  # -> flatten(Result)
entwine_3 = Entwine(
    Branch00=createdesigninformation_3.orientation_3,
    Branch01=createdesigninformation.orientation_3,
    Branch02=createdesigninformation_2.orientation_3,
    Branch03=createdesigninformation_6.orientation_3,
    Branch04=createdesigninformation_4.orientation_3,
    Branch05=createdesigninformation_5.orientation_3,
    FlattenInputs=True)  # -> flatten(Result)
entwine_4 = Entwine(
    Branch00=createdesigninformation_3.windowfloorratio_2,
    Branch01=createdesigninformation.windowfloorratio_2,
    Branch02=createdesigninformation_2.windowfloorratio_2,
    Branch03=createdesigninformation_6.windowfloorratio_2,
    Branch04=createdesigninformation_4.windowfloorratio_2,
    Branch05=createdesigninformation_5.windowfloorratio_2,
    FlattenInputs=True)  # -> flatten(Result)
entwine_5 = Entwine(
    Branch00=createdesigninformation_3.viewnature_8,
    Branch01=createdesigninformation.viewnature_8,
    Branch02=createdesigninformation_2.viewnature_8,
    Branch03=createdesigninformation_6.viewnature_8,
    Branch04=createdesigninformation_4.viewnature_8,
    Branch05=createdesigninformation_5.viewnature_8,
    FlattenInputs=True)  # -> flatten(Result)
entwine_6 = Entwine(
    Branch00=createdesigninformation_3.areaid_2,
    Branch01=createdesigninformation.areaid_2,
    Branch02=createdesigninformation_2.areaid_2,
    Branch03=createdesigninformation_6.areaid_2,
    Branch04=createdesigninformation_4.areaid_2,
    Branch05=createdesigninformation_5.areaid_2,
    FlattenInputs=True)  # -> flatten(Result)
entwine_7 = Entwine(
    Branch00=createdesigninformation_3.elevation_8,
    Branch01=createdesigninformation.elevation_8,
    Branch02=createdesigninformation_2.elevation_8,
    Branch03=createdesigninformation_6.elevation_8,
    Branch04=createdesigninformation_4.elevation_8,
    Branch05=createdesigninformation_5.elevation_8,
    FlattenInputs=True)  # -> flatten(Result)
entwine_8 = Entwine(
    Branch00=createdesigninformation_3.windowarea_2,
    Branch01=createdesigninformation.windowarea_2,
    Branch02=createdesigninformation_2.windowarea_2,
    Branch03=createdesigninformation_6.windowarea_2,
    Branch04=createdesigninformation_4.windowarea_2,
    Branch05=createdesigninformation_5.windowarea_2,
    FlattenInputs=True)  # -> flatten(Result)
entwine_9 = Entwine(
    Branch00=createdesigninformation_3.doorconnection1_8,
    Branch01=createdesigninformation.doorconnection1_8,
    Branch02=createdesigninformation_2.doorconnection1_8,
    Branch03=createdesigninformation_6.doorconnection1_8,
    Branch04=createdesigninformation_4.doorconnection1_8,
    Branch05=createdesigninformation_5.doorconnection1_8,
    FlattenInputs=True)  # -> flatten(Result)
entwine_10 = Entwine(
    Branch00=createdesigninformation_3.viewurban_8,
    Branch01=createdesigninformation.viewurban_8,
    Branch02=createdesigninformation_2.viewurban_8,
    Branch03=createdesigninformation_6.viewurban_8,
    Branch04=createdesigninformation_4.viewurban_8,
    Branch05=createdesigninformation_5.viewurban_8,
    FlattenInputs=True)  # -> flatten(Result)
entwine_11 = Entwine(
    Branch00=createdesigninformation_3.entitysubtype_2,
    Branch01=createdesigninformation.entitysubtype_2,
    Branch02=createdesigninformation_2.entitysubtype_2,
    Branch03=createdesigninformation_6.entitysubtype_2,
    Branch04=createdesigninformation_4.entitysubtype_2,
    Branch05=createdesigninformation_5.entitysubtype_2,
    FlattenInputs=True)  # -> flatten(Result)
entwine_12 = Entwine(
    Branch00=createdesigninformation_3.height_4,
    Branch01=createdesigninformation.height_4,
    Branch02=createdesigninformation_2.height_4,
    Branch03=createdesigninformation_6.height_4,
    Branch04=createdesigninformation_4.height_4,
    Branch05=createdesigninformation_5.height_4,
    FlattenInputs=True)  # -> flatten(Result)
entwine_13 = Entwine(
    Branch00=createdesigninformation_3.roomarea_2,
    Branch01=createdesigninformation.roomarea_2,
    Branch02=createdesigninformation_2.roomarea_2,
    Branch03=createdesigninformation_6.roomarea_2,
    Branch04=createdesigninformation_4.roomarea_2,
    Branch05=createdesigninformation_5.roomarea_2,
    FlattenInputs=True)  # -> flatten(Result)
entwine_14 = Entwine(
    Branch00=createdesigninformation_3.doorconnection2_8,
    Branch01=createdesigninformation.doorconnection2_8,
    Branch02=createdesigninformation_2.doorconnection2_8,
    Branch03=createdesigninformation_6.doorconnection2_8,
    Branch04=createdesigninformation_4.doorconnection2_8,
    Branch05=createdesigninformation_5.doorconnection2_8,
    FlattenInputs=True)  # -> flatten(Result)
entwine_15 = Entwine(
    Branch00=entwine,
    Branch01=entwine_6,
    Branch02=entwine_11,
    Branch03=entwine_2,
    Branch04=entwine_7,
    Branch05=entwine_12,
    Branch06=entwine_3,
    Branch07=entwine_8,
    Branch08=entwine_13,
    Branch09=entwine_4,
    Branch010=entwine_9,
    Branch011=entwine_14,
    Branch012=entwine_5,
    Branch013=entwine_10,
    FlattenInputs=True)

# ----
# Create CSV file
headings = Panel("""apartment_id
area_id
entity_subtype
geometry
elevation
height
orientation
window_area
layout_area
window_floor_ratio
door_connection1
door_connection2
view_landscape_nature_mean
view_landscape_urban_mean""")
button = Button()
filepath_2 = FilePath("C:\Users\Name\OneDrive - Delft University of Technology\Building Technology-Thesis\CaseStudy\CaseStudy2\df_casestudy2_designs.csv")
excelwrite = ExcelWrite(
    WriteExcelData=button,
    WorkbookPath=filepath_2,
    WorksheetName="casestudy_designs",
    ColumnHeadings=headings,
    Data=entwine_15,
    ClearSheet=button)

panel_12 = Panel(filepath_2)

# ==== cluster CreateDesignInformation

outsidedoorpolygons = ClusterInput()
outsidedoorheight = ClusterInput()  # WindowHeight

designname = ClusterInput()  # DesignName
roomtypes = ClusterInput()
startareaid = ClusterInput()  # StartAreaID
elevation = ClusterInput()
height = ClusterInput()

roompolygons = ClusterInput()

windowpolygons = ClusterInput()
windowsill = ClusterInput()  # WindowSill
windowheight = ClusterInput()  # WindowHeight

# ----
# Create window data
design1_windows = Geometry(windowpolygons)
debrep = DeconstructBrep(Brep=design1_windows)  # -> Faces, Edges, Vertices
pt_to_wkt = GhPythonScript(pt_list=debrep.Vertices)  # -> out, flatten(wkt_polygon); inputs pt_list: list of Point3d
# ---------- pt_to_wkt: Python ----------
"""Provides a scripting component.
    Inputs:
        wkt_polygon: Text from dataset with polygon info
    Output:
        x : 
        pt_list: List of points in polygon"""

__author__ = "LotteKat"
__version__ = "2023.07.14"

import rhinoscriptsyntax as rs
import re

polygon_string = "POLYGON(("

for point in pt_list:
    # Access the Grasshopper list elements using Grasshopper-specific methods
    x = point[0]
    y = point[1]
    z = point[2]
    
    polygon_string += str(x) + " " + str(y) + ","

# Repeat first point and add the closing parenthesis
end_pt = pt_list[0]
x_end = end_pt[0]
y_end = end_pt[1]

polygon_string += str(x_end) + " " + str(y_end) + "))"

wkt_polygon = polygon_string
# ---------- end pt_to_wkt ----------
panel = Panel(pt_to_wkt.wkt_polygon)
lng = ListLength(List=pt_to_wkt.wkt_polygon)

# ----
# Create room data
design1_rooms = Geometry(roompolygons)
debrep_2 = DeconstructBrep(Brep=design1_rooms)  # -> Faces, Edges, Vertices
pt_to_wkt_2 = GhPythonScript(pt_list=debrep_2.Vertices)  # -> out, flatten(wkt_polygon); inputs pt_list: list of Point3d; same code as pt_to_wkt
panel_2 = Panel(pt_to_wkt_2.wkt_polygon)
lng_2 = ListLength(List=pt_to_wkt_2.wkt_polygon)
nrrooms = Data(lng_2)
roomtypes_2 = Data(roomtypes)

# ----
# Create outside door data
outside_door = Geometry(outsidedoorpolygons)
debrep_3 = DeconstructBrep(Brep=outside_door)  # -> Faces, Edges, Vertices
pt_to_wkt_3 = GhPythonScript(pt_list=debrep_3.Vertices)  # -> out, flatten(wkt_polygon); inputs pt_list: list of Point3d; same code as pt_to_wkt
lng_3 = ListLength(List=pt_to_wkt_3.wkt_polygon)

# ----
# Find window area
windowheight_2 = Data(windowheight)
item = ListItem(List=debrep.Edges, Index=0, Wrap=True)  # -> flatten(Item)
nrwindows = Data(lng)
repeat = RepeatData(Data=windowheight_2, Length=nrwindows)
len = Length(Curve=item)
multiplication = Multiplication(A=len, B=repeat)

# ----
# Find window area
outsidedoorheight_2 = Data(outsidedoorheight)
nroutsidedoors = Data(lng_3)
item_2 = ListItem(List=debrep_3.Edges, Index=0, Wrap=True)  # -> flatten(Item)
repeat_2 = RepeatData(Data=outsidedoorheight_2, Length=nroutsidedoors)
len_2 = Length(Curve=item_2)
multiplication_2 = Multiplication(A=len_2, B=repeat_2)

outsidedoorm2 = Data(multiplication_2)
windowm2 = Data(multiplication)
entwine = Entwine(Branch00=windowm2, Branch01=outsidedoorm2, FlattenInputs=True)  # -> flatten(Result)

# ----
# Additional information to
# create landscape values
viewlandscapenature = Panel("""2.283
2.825
2.263
0
0
0.00
1.028
2.031""")
viewlandscapeurban = Panel("""0.924
1.136
0.984
0
0
0.00
0.496
0.193""")
spaces_polygons = Geometry([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])

midpt = CurveMiddle(Curve=item)
area = Area(Geometry=design1_windows)  # -> Area, Centroid
ln = Line(StartPoint=midpt, EndPoint=area.Centroid)
unit = UnitVector(Vector=ln)

midpt_2 = CurveMiddle(Curve=item_2)
area_2 = Area(Geometry=outside_door)  # -> Area, Centroid
ln_2 = Line(StartPoint=midpt_2, EndPoint=area_2.Centroid)
unit_2 = UnitVector(Vector=ln_2)

Y = UnitY(Factor=1)
rev = Reverse(Vector=Y)

Y_2 = UnitY(Factor=1)
rev_2 = Reverse(Vector=Y_2)

# ----
# Find 2 closest points
area_3 = Area(Geometry=spaces_polygons)  # -> Area, Centroid
design1_rooms_2 = Geometry(design1_rooms)
cull_i = CullIndex(List=area_3.Centroid, Indices="-1", Wrap=True)
area_4 = Area(Geometry=design1_rooms_2)  # -> Area, Centroid
cps = ClosestPoints(Point=area_4.Centroid, Cloud=cull_i, Count="2")  # -> ClosestPoint, CPIndex, Distance

nrwindows_2 = Data(lng)

elevation_2 = Data(elevation)
item_3 = ListItem(List=elevation_2, Index=1, Wrap=True)
windowsill_2 = Data(windowsill)
addition = Addition(A=item_3, B=windowsill_2)
repeat_3 = RepeatData(Data=addition, Length=nrwindows_2)

nroutsidedoors_2 = Data(lng_3)

elevation_3 = Data(elevation)
item_4 = ListItem(List=elevation_3, Index=1, Wrap=True)
repeat_4 = RepeatData(Data=item_4, Length=nroutsidedoors_2)

outsidedoorheight_3 = Data(outsidedoorheight)
addition_2 = Addition(A=item_4, B=outsidedoorheight_3)
repeat_5 = RepeatData(Data=addition_2, Length=nroutsidedoors_2)

# ----
# Find window orientation
find_orientation = GhPythonScript(vector1=unit, vector2=rev)  # -> out, orientation, angle_radians, direction; inputs vector1: Vector3d, vector2: Vector3d
# ---------- find_orientation: Python ----------
__author__ = "Name"
__version__ = "2023.10.27"

import rhinoscriptsyntax as rs
import math

vector1_x = vector1[0]
angle_radians = vector1.VectorAngle(vector1, vector2)


if vector1_x > 0 :
    reflex_angle_radians = angle_radians -(2 * math.pi)
    reflex_angle_degrees = abs(math.degrees(reflex_angle_radians))
    degrees = reflex_angle_degrees
    print("The first point of the vector is in the positive direction.")
    print("Degrees =", reflex_angle_degrees)
else:
    angle_degrees = abs(math.degrees(angle_radians))
    degrees = angle_degrees
    print("The first point of the vector is in the negative direction.")
    print("Degrees =",angle_degrees)

# Define a dictionary with compass orientations and their degree ranges
orientation_ranges = {
    "North": (337.5, 22.5),
    "North-East": (22.5, 67.5),
    "East": (67.5, 112.5),
    "South-East": (112.5, 157.5),
    "South": (157.5, 202.5),
    "South-West": (202.5, 247.5),
    "West": (247.5, 292.5),
    "North-West": (292.5, 337.5)
}

# Find the orientation for the given degree
orientation = None
for direction, (min_angle, max_angle) in orientation_ranges.items():
    if min_angle <= degrees < max_angle:
        orientation = direction
        print(orientation)
        break

#print("The orientation at", degrees, "degrees is", orientation)
# ---------- end find_orientation ----------
window_orientation = Panel(find_orientation.orientation)

windowheight_3 = Data(windowheight)
addition_3 = Addition(A=addition, B=windowheight_3)
repeat_6 = RepeatData(Data=addition_3, Length=nrwindows_2)

# ----
# Find outside door orientation
find_orientation_2 = GhPythonScript(vector1=unit_2, vector2=rev_2)  # -> out, orientation, angle_radians, direction; inputs vector1: Vector3d, vector2: Vector3d; same code as find_orientation
orientation = Panel(find_orientation_2.orientation)

outsidedoororientation = Data(find_orientation_2.orientation)
windoworientation = Data(find_orientation.orientation)
entwine_2 = Entwine(Branch00=windoworientation, Branch01=outsidedoororientation, FlattenInputs=True)  # -> flatten(Result)

type_name = Panel("OUTSIDE_DOOR")
nroutsidedoors_3 = Data(lng_3)
designname_2 = Data(designname)
repeat_7 = RepeatData(Data=designname_2, Length=nroutsidedoors_3)
repeat_8 = RepeatData(Data=type_name, Length=nroutsidedoors_3)

type_name_2 = Panel("WINDOW")
nrwindows_3 = Data(lng)
designname_3 = Data(designname)
repeat_9 = RepeatData(Data=designname_3, Length=nrwindows_3)
repeat_10 = RepeatData(Data=type_name_2, Length=nrwindows_3)

startareaid_2 = Data(startareaid)
series = Series(Start=startareaid_2, Step=1, Count=nrrooms)
roomareaids = Data(series)

# ----
# Connect room area_ID with windows
design1_rooms_3 = Geometry(roompolygons)
roomareaids_2 = Data(roomareaids)
roomtypes_3 = Data(roomtypes)
findintersection = GhPythonScript(room_curves=design1_rooms_3, room_IDs=roomareaids_2, room_types=roomtypes_3, window_curves=outside_door)  # -> out, window_room_connection; inputs room_curves: list, room_IDs: list of Int32, room_types: list, window_curves: list
# ---------- findintersection: Python ----------
__author__ = "Name"
__version__ = "2023.10.29"

import rhinoscriptsyntax as rs

# Check if the input curves are valid
window_room_connection = []

for i, room_type in enumerate(room_types):
    if room_type == 'OUTDOOR_SPACE':
        index_outdoorspace = i
        break  # Stop searching once the name is found
print(index_outdoorspace)

outside_room_IDs = room_IDs.pop(index_outdoorspace)
utside_room_curve = room_curves.pop(index_outdoorspace)
print(room_IDs)

for window_curve in window_curves: 
    for i in range(len(room_IDs)):
        #print(i)
        # Find the intersection points between the two curves
        room_curve = room_curves[i]
        intersection_points = rs.CurveCurveIntersection(room_curve, window_curve)
        
        if intersection_points:
            # Output the intersection points
            test = 'Yes'
            room_ID = room_IDs[i]
            window_room_connection.append(room_ID)
        else:
            # If there are no intersections, output a message
            test = "No intersection"
    
    # Output Parameters
print(window_room_connection)
# ---------- end findintersection ----------
outsideareaids = Data(findintersection.window_room_connection)

# ----
# Connect room area_ID with windows
design1_rooms_4 = Geometry(roompolygons)
roomareaids_3 = Data(roomareaids)
roomtypes_4 = Data(roomtypes)
findintersection_2 = GhPythonScript(room_curves=design1_rooms_4, room_IDs=roomareaids_3, room_types=roomtypes_4, window_curves=design1_windows)  # -> out, window_room_connection; inputs room_curves: list, room_IDs: list of Int32, room_types: list, window_curves: list; same code as findintersection
windowareaids = Data(findintersection_2.window_room_connection)

outsidedoorareaids = Data(outsideareaids)
# Combine window and outside door data
windowareaids_2 = Data(windowareaids)
entwine_3 = Entwine(Branch00=windowareaids_2, Branch01=outsidedoorareaids, FlattenInputs=True)  # -> flatten(Result)

# ----
# Find window area and
# main orientation per room
roomareaids_4 = Data(roomareaids)
roomtypes_5 = Data(roomtypes)
window_m2_and_orientation = GhPythonScript(
    area_id_rooms=roomareaids_4,
    room_types=roomtypes_5,
    area_id_windows=entwine_3,
    area_sqm_windows=entwine,
    orientations_windows=entwine_2,
    outside_door_orientation=outsidedoororientation)  # -> out, room_window_sqm, main_orientation; inputs area_id_rooms: list of Int32, room_types: list, area_id_windows: list of Int32, area_sqm_windows: list, orientations_windows: list
# ---------- window_m2_and_orientation: Python ----------
__author__ = "LotteKat"
__version__ = "2023.10.27"

import rhinoscriptsyntax as rs

# Create a dictionary to store the sums for each area_id_windows
room_window_sqm = []
main_orientation = []

# Iterate through the lists
for i in range(len(area_id_rooms)): 
    id_room = area_id_rooms[i]
    #print(id_room)
    sqm_window = 0 
    room_orientations = []
    room_orientation = None
    room_type = room_types[i]

    for j in range(len(area_id_windows)):
        id_window = area_id_windows[j]
        
        if id_window == id_room:
            window_area = area_sqm_windows[j]
            window_orientation = str(orientations_windows[j])
            
            sqm_window += window_area
            #print('window in room', sqm_window)
            room_orientations.append(window_orientation)

    sqm_windows = sqm_window
    room_window_sqm.append(sqm_windows)
    #print(room_orientations)
    room_orientations_clean = list(set(room_orientations))

    if len(room_orientations_clean) >1:
        #print("mutliple sides")
        room_orientation_temp = None
        orientation_window_sqm = 0

        for orient in room_orientations_clean:
            orientation_window_sqm1 = 0
            for j in range(len(area_id_windows)):
                id_window = area_id_windows[j]
                window_orientation = str(orientations_windows[j])
                if id_window == id_room and window_orientation == orient:
                    window_area = area_sqm_windows[j]
                    orientation_window_sqm1 += window_area
            if orientation_window_sqm1 > orientation_window_sqm:
                orientation_window_sqm = orientation_window_sqm1
                room_orientation_temp = orient
        room_orientation = room_orientation_temp

    elif len(room_orientations_clean) == 1:
        room_orientation = room_orientations[0]
    
    elif room_type == 'OUTDOOR_SPACE':
         room_orientation = outside_door_orientation
    
    main_orientation.append(room_orientation)
# ---------- end window_m2_and_orientation ----------
nullrep = ReplaceNulls(Items=window_m2_and_orientation.main_orientation, Replacements="0")  # -> Items, Count
main_room_orientation = Panel(nullrep.Items)
m2_window_per_room = Panel(window_m2_and_orientation.room_window_sqm)

# ----
# Connect room area_ID with doors
design1_rooms_5 = Geometry(roompolygons)
roomareaids_5 = Data(roomareaids)
findintersection_3 = GhPythonScript(room_curves=design1_rooms_5, room_IDs=roomareaids_5, door_curves=outside_door)  # -> out, door_room_connection1, door_room_connection2; inputs room_curves: list, room_IDs: list of Int32, door_curves: list
# ---------- findintersection_3: Python ----------
__author__ = "LotteKat"
__version__ = "2023.10.29"

import rhinoscriptsyntax as rs

# Check if the input curves are valid
door_room_connection1 = []
door_room_connection2 = []

for door_curve in door_curves:
    door_intersections = []
    for i in range(len(room_IDs)):
        #print(i)
        # Find the intersection points between the two curves
        room_curve = room_curves[i]
        intersection_points = rs.CurveCurveIntersection(room_curve, door_curve)
        
        if intersection_points:
            room_ID = room_IDs[i]
            
            door_intersections.append(room_ID)
    #print(door_intersections)
    door_room_connection1.append(door_intersections[0])
    door_room_connection2.append(door_intersections[1])
    # Output Parameters
print(door_room_connection1)
print(door_room_connection2)
# ---------- end findintersection_3 ----------

nroutsidedoors_4 = Data(lng_3)
repeat_11 = RepeatData(Data="0", Length=nroutsidedoors_4)

nrwindows_4 = Data(lng)
repeat_12 = RepeatData(Data="0", Length=nrwindows_4)

design1_rooms_6 = Geometry(roompolygons)
area_5 = Area(Geometry=design1_rooms_6)  # -> Area, Centroid
division = Division(A=window_m2_and_orientation.room_window_sqm, B=area_5.Area)

nrrooms_2 = Data(lng_2)

designname_4 = Data(designname)
repeat_13 = RepeatData(Data=designname_4, Length=nrrooms)

elevation_4 = Data(elevation)
repeat_14 = RepeatData(Data=elevation_4, Length=nrrooms_2)

height_2 = Data(height)
repeat_15 = RepeatData(Data=height_2, Length=nrrooms_2)

nrrooms_3 = Data(lng_2)
repeat_16 = RepeatData(Data="0", Length=nrrooms_3)

# ----
# Create new view data
newviewdata = GhPythonScript(pt_index=cps.CPIndex, distance=cps.Distance, view_nature_OG=viewlandscapenature, view_urban_OG=viewlandscapeurban)  # -> out, view_nature, view_urban; inputs pt_index: tree of Int32, distance: tree, view_nature_OG: list, view_urban_OG: list
# ---------- newviewdata: Python ----------
__author__ = "LotteKat"
__version__ = "2023.10.29"

import rhinoscriptsyntax as rs

# Get the number of branches in the pt_index tree
num_branches = pt_index.BranchCount
print(num_branches)
view_nature = []
view_urban = []

for i in range(num_branches):
    # Get the ith branch from pt_index and distance
    pt_index_branch = pt_index.Branch(i)
    distance_branch = distance.Branch(i)
    
    distance_branch = [x if x != 0 else 0.001 for x in distance_branch]

    min_dist = min(distance_branch)
    tot_dist_factor = (min_dist / distance_branch[0]) + (min_dist / distance_branch[1])

    new_nature1 = float(view_nature_OG[pt_index_branch[0]]) * min_dist / distance_branch[0]
    new_nature2 = float(view_nature_OG[pt_index_branch[1]]) * min_dist / distance_branch[1]
    new_nature = (new_nature1 + new_nature2) / tot_dist_factor

    new_urban1 = float(view_urban_OG[pt_index_branch[0]]) * min_dist / distance_branch[0]
    new_urban2 = float(view_urban_OG[pt_index_branch[1]]) * min_dist / distance_branch[1]
    new_urban = (new_urban1 + new_urban2) / tot_dist_factor

    view_nature.append(new_nature)
    view_urban.append(new_urban)

print(view_nature)
# ---------- end newviewdata ----------
view_to_nature = Panel(newviewdata.view_nature)
view_to_urban = Panel(newviewdata.view_urban)

design1_orientationwindows = Data(find_orientation_2.orientation)
design1_areawindows = Data(multiplication_2)
design1_name = Data(repeat_7)
design1_areaid = Data(outsideareaids)
design1_roomtype = Data(repeat_8)
design1_geometry = Data(pt_to_wkt_3.wkt_polygon)
design1_elevation = Data(repeat_4)
design1_height = Data(repeat_5)
design1_arearoom = Data(repeat_11)
doorconnection1 = Data(findintersection_3.door_room_connection1)
doorconnection2 = Data(findintersection_3.door_room_connection2)
design1_windowfloorratio = Data(repeat_11)
viewnature = Data(repeat_11)
viewurban = Data(repeat_11)

design1_orientationwindows_2 = Data(find_orientation.orientation)
design1_areawindows_2 = Data(multiplication)
design1_name_2 = Data(repeat_9)
design1_areaid_2 = Data(windowareaids)
design1_roomtype_2 = Data(repeat_10)
design1_geometry_2 = Data(pt_to_wkt.wkt_polygon)
design1_elevation_2 = Data(repeat_3)
design1_height_2 = Data(repeat_6)
design1_arearoom_2 = Data(repeat_12)
doorconnection1_2 = Data(repeat_12)
doorconnection2_2 = Data(repeat_12)
design1_windowfloorratio_2 = Data(repeat_12)
viewnature_2 = Data(repeat_12)
viewurban_2 = Data(repeat_12)

design1_name_3 = Data(repeat_13)
design1_areaid_3 = Data(series)
design1_roomtype_3 = Data(roomtypes_2)
design1_geometry_3 = Data(pt_to_wkt_2.wkt_polygon)
design1_elevation_3 = Data(repeat_14)
design1_height_3 = Data(repeat_15)
design1_windowfloorratio_3 = Data(division)
design1_areawindows_3 = Data(window_m2_and_orientation.room_window_sqm)
design1_arearoom_3 = Data(area_5.Area)
design1_orientationroom = Data(nullrep.Items)
doorconnection1_3 = Data(repeat_16)
doorconnection2_3 = Data(repeat_16)
viewnature_3 = Data(newviewdata.view_nature)
viewurban_3 = Data(newviewdata.view_urban)

flooroutdoorspacepolygon = ClusterInput()
floorpolygon = ClusterInput()

doorpolygons = ClusterInput()

# ----
# Create door data
design1_doors = Geometry(doorpolygons)
type_name_3 = Panel("DOOR")
debrep_4 = DeconstructBrep(Brep=design1_doors)  # -> Faces, Edges, Vertices
pt_to_wkt_4 = GhPythonScript(pt_list=debrep_4.Vertices)  # -> out, flatten(wkt_polygon); inputs pt_list: list of Point3d; same code as pt_to_wkt
lng_4 = ListLength(List=pt_to_wkt_4.wkt_polygon)
repeat_17 = RepeatData(Data=type_name_3, Length=lng_4)

# ----
# Create floor balcony data
floorospoly = Geometry(flooroutdoorspacepolygon)
type_name_4 = Panel("FLOOR_OUTDOOR_SPACE")
debrep_5 = DeconstructBrep(Brep=floorospoly)  # -> Faces, Edges, Vertices
pt_to_wkt_5 = GhPythonScript(pt_list=debrep_5.Vertices)  # -> out, flatten(wkt_polygon); inputs pt_list: list of Point3d; same code as pt_to_wkt
lng_5 = ListLength(List=pt_to_wkt_5.wkt_polygon)
repeat_18 = RepeatData(Data=type_name_4, Length=lng_5)

# ----
# Create floor data
type_name_5 = Panel("FLOOR")
floorpoly = Geometry(floorpolygon)
debrep_6 = DeconstructBrep(Brep=floorpoly)  # -> Faces, Edges, Vertices
pt_to_wkt_6 = GhPythonScript(pt_list=debrep_6.Vertices)  # -> out, flatten(wkt_polygon); inputs pt_list: list of Point3d; same code as pt_to_wkt
lng_6 = ListLength(List=pt_to_wkt_6.wkt_polygon)
repeat_19 = RepeatData(Data=type_name_5, Length=lng_6)

# ----
# Connect room area_ID with doors
design1_rooms_7 = Geometry(roompolygons)
roomareaids_6 = Data(roomareaids)
findintersection_4 = GhPythonScript(room_curves=design1_rooms_7, room_IDs=roomareaids_6, door_curves=design1_doors)  # -> out, door_room_connection1, door_room_connection2; inputs room_curves: list, room_IDs: list of Int32, door_curves: list
# ---------- findintersection_4: Python ----------
__author__ = "LotteKat"
__version__ = "2023.10.29"

import rhinoscriptsyntax as rs

# Check if the input curves are valid
door_room_connection1 = []
door_room_connection2 = []

for door_curve in door_curves:
    door_intersections = []
    for i in range(len(room_IDs)):
        #print(i)
        # Find the intersection points between the two curves
        room_curve = room_curves[i]
        intersection_points = rs.CurveCurveIntersection(room_curve, door_curve)
        
        if intersection_points:
            room_ID = room_IDs[i]
            
            door_intersections.append(room_ID)
    #print(door_intersections)
    door_room_connection1.append(door_intersections[0])
    if len(door_intersections) >= 2:
        door_room_connection2.append(door_intersections[1])
    
    else:
        door_room_connection2.append(0)
    
    # Output Parameters
print(door_room_connection1)
print(door_room_connection2)
# ---------- end findintersection_4 ----------

designname_5 = Data(designname)
repeat_20 = RepeatData(Data=designname_5, Length=lng_5)

designname_6 = Data(designname)
repeat_21 = RepeatData(Data=designname_6, Length=lng_6)

elevation_5 = Data(elevation)
repeat_22 = RepeatData(Data=elevation_5, Length=lng_6)

designname_7 = Data(designname)
repeat_23 = RepeatData(Data=designname_7, Length=lng_4)

elevation_6 = Data(elevation)
repeat_24 = RepeatData(Data=elevation_6, Length=lng_5)

repeat_25 = RepeatData(Data="0", Length=lng_6)

repeat_26 = RepeatData(Data="0", Length=lng_5)

repeat_27 = RepeatData(Data="0", Length=lng_4)

design1_orientationwindows_3 = Data(repeat_27)
design1_areawindows_4 = Data(repeat_27)
design1_name_4 = Data(repeat_23)
design1_areaid_4 = Data(repeat_27)
design1_roomtype_4 = Data(repeat_17)
design1_geometry_4 = Data(pt_to_wkt_4.wkt_polygon)
design1_elevation_4 = Data(repeat_27)
design1_height_4 = Data(repeat_27)
design1_arearoom_4 = Data(repeat_27)
viewnature_4 = Data(repeat_27)
design1_windowfloorratio_4 = Data(repeat_27)
viewurban_4 = Data(repeat_27)
doorconnection1_4 = Data(findintersection_4.door_room_connection1)
doorconnection2_4 = Data(findintersection_4.door_room_connection2)

design1_orientationwindows_4 = Data(repeat_26)
design1_areawindows_5 = Data(repeat_26)
design1_name_5 = Data(repeat_20)
design1_areaid_5 = Data(repeat_26)
design1_roomtype_5 = Data(repeat_18)
design1_geometry_5 = Data(pt_to_wkt_5.wkt_polygon)
design1_elevation_5 = Data(repeat_24)
design1_height_5 = Data(repeat_26)
design1_arearoom_5 = Data(repeat_26)
design1_windowfloorratio_5 = Data(repeat_26)
doorconnection1_5 = Data(repeat_26)
doorconnection2_5 = Data(repeat_26)
viewnature_5 = Data(repeat_26)
viewurban_5 = Data(repeat_26)

design1_orientationwindows_5 = Data(repeat_25)
design1_areawindows_6 = Data(repeat_25)
design1_name_6 = Data(repeat_21)
design1_areaid_6 = Data(repeat_25)
design1_roomtype_6 = Data(repeat_19)
design1_geometry_6 = Data(pt_to_wkt_6.wkt_polygon)
design1_elevation_6 = Data(repeat_22)
design1_height_6 = Data(repeat_25)
design1_arearoom_6 = Data(repeat_25)
doorconnection1_6 = Data(repeat_25)
viewnature_6 = Data(repeat_25)
design1_windowfloorratio_6 = Data(repeat_25)
doorconnection2_6 = Data(repeat_25)
viewurban_6 = Data(repeat_25)

# ----
# Create output
entwine_4 = Entwine(
    Branch00=design1_name_3,
    Branch01=design1_name_2,
    Branch02=design1_name,
    Branch03=design1_name_4,
    Branch04=design1_name_6,
    Branch05=design1_name_5,
    FlattenInputs=True)  # -> flatten(Result)
name = Data(entwine_4)
designname_8 = ClusterOutput(name)  # DesignName

entwine_5 = Entwine(
    Branch00=design1_areaid_3,
    Branch01=design1_areaid_2,
    Branch02=design1_areaid,
    Branch03=design1_areaid_4,
    Branch04=design1_areaid_6,
    Branch05=design1_areaid_5,
    FlattenInputs=True)  # -> flatten(Result)
areaid = Data(entwine_5)
areaid_2 = ClusterOutput(areaid)

entwine_6 = Entwine(
    Branch00=design1_roomtype_3,
    Branch01=design1_roomtype_2,
    Branch02=design1_roomtype,
    Branch03=design1_roomtype_4,
    Branch04=design1_roomtype_6,
    Branch05=design1_roomtype_5,
    FlattenInputs=True)  # -> flatten(Result)
entitysubtype = Data(entwine_6)
entitysubtype_2 = ClusterOutput(entitysubtype)

entwine_7 = Entwine(
    Branch00=design1_geometry_3,
    Branch01=design1_geometry_2,
    Branch02=design1_geometry,
    Branch03=design1_geometry_4,
    Branch04=design1_geometry_6,
    Branch05=design1_geometry_5,
    FlattenInputs=True)  # -> flatten(Result)
geometry = Data(entwine_7)
geometry_2 = ClusterOutput(geometry)

entwine_8 = Entwine(
    Branch00=design1_elevation_3,
    Branch01=design1_elevation_2,
    Branch02=design1_elevation,
    Branch03=design1_elevation_4,
    Branch04=design1_elevation_6,
    Branch05=design1_elevation_5,
    FlattenInputs=True)  # -> flatten(Result)
elevation_7 = Data(entwine_8)
elevation_8 = ClusterOutput(elevation_7)

entwine_9 = Entwine(
    Branch00=design1_height_3,
    Branch01=design1_height_2,
    Branch02=design1_height,
    Branch03=design1_height_4,
    Branch04=design1_height_6,
    Branch05=design1_height_5,
    FlattenInputs=True)  # -> flatten(Result)
height_3 = Data(entwine_9)
height_4 = ClusterOutput(height_3)

entwine_10 = Entwine(
    Branch00=design1_orientationroom,
    Branch01=design1_orientationwindows_2,
    Branch02=design1_orientationwindows,
    Branch03=design1_orientationwindows_3,
    Branch04=design1_orientationwindows_5,
    Branch05=design1_orientationwindows_4,
    FlattenInputs=True)  # -> flatten(Result)
orientation_2 = Data(entwine_10)
orientation_3 = ClusterOutput(orientation_2)

entwine_11 = Entwine(
    Branch00=design1_areawindows_3,
    Branch01=design1_areawindows_2,
    Branch02=design1_areawindows,
    Branch03=design1_areawindows_4,
    Branch04=design1_areawindows_6,
    Branch05=design1_areawindows_5,
    FlattenInputs=True)  # -> flatten(Result)
windowarea = Data(entwine_11)
windowarea_2 = ClusterOutput(windowarea)

entwine_12 = Entwine(
    Branch00=design1_arearoom_3,
    Branch01=design1_arearoom_2,
    Branch02=design1_arearoom,
    Branch03=design1_arearoom_4,
    Branch04=design1_arearoom_6,
    Branch05=design1_arearoom_5,
    FlattenInputs=True)  # -> flatten(Result)
roomarea = Data(entwine_12)
roomarea_2 = ClusterOutput(roomarea)

entwine_13 = Entwine(
    Branch00=design1_windowfloorratio_3,
    Branch01=design1_windowfloorratio_2,
    Branch02=design1_windowfloorratio,
    Branch03=design1_windowfloorratio_4,
    Branch04=design1_windowfloorratio_6,
    Branch05=design1_windowfloorratio_5,
    FlattenInputs=True)  # -> flatten(Result)
windowfloorratio = Data(entwine_13)
windowfloorratio_2 = ClusterOutput(windowfloorratio)

entwine_14 = Entwine(
    Branch00=doorconnection1_3,
    Branch01=doorconnection1_2,
    Branch02=doorconnection1,
    Branch03=doorconnection1_4,
    Branch04=doorconnection1_6,
    Branch05=doorconnection1_5,
    FlattenInputs=True)  # -> flatten(Result)
doorconnection1_7 = Data(entwine_14)
doorconnection1_8 = ClusterOutput(doorconnection1_7)

entwine_15 = Entwine(
    Branch00=doorconnection2_3,
    Branch01=doorconnection2_2,
    Branch02=doorconnection2,
    Branch03=doorconnection2_4,
    Branch04=doorconnection2_6,
    Branch05=doorconnection2_5,
    FlattenInputs=True)  # -> flatten(Result)
doorconnection2_7 = Data(entwine_15)
doorconnection2_8 = ClusterOutput(doorconnection2_7)

entwine_16 = Entwine(
    Branch00=viewnature_3,
    Branch01=viewnature_2,
    Branch02=viewnature,
    Branch03=viewnature_4,
    Branch04=viewnature_6,
    Branch05=viewnature_5,
    FlattenInputs=True)  # -> flatten(Result)
viewnature_7 = Data(entwine_16)
viewnature_8 = ClusterOutput(viewnature_7)

entwine_17 = Entwine(
    Branch00=viewurban_3,
    Branch01=viewurban_2,
    Branch02=viewurban,
    Branch03=viewurban_4,
    Branch04=viewurban_6,
    Branch05=viewurban_5,
    FlattenInputs=True)  # -> flatten(Result)
viewurban_7 = Data(entwine_17)
viewurban_8 = ClusterOutput(viewurban_7)
